# Grasshopper definition Main.gh (Grasshopper 1.0.7)
# plug-ins: Human UI, DynaModel

# ---- group: Input Label
panel = Panel("------------------------------------Output--------------------------------------")
textsize = Slider(13, range=0..1000)
height = Slider(35, range=0..1000)
width = Slider(600, range=0..1000)
label = CreateLabel(LabelText=panel, LabelSize=textsize, Justification=0)
adjustpos = AdjustElementPositioning(ElementsToAdjust=label, Margin="60,10,5,10", AbsolutePositioning=False, Width=width, Height=height)

# ---- group: Main Window
launchwin = LaunchWindow(
    Show=Toggle(True),
    Name="3D Model Interaction Tool",
    Width=Slider(600, range=0..1000),
    Height=Slider(600, range=0..1000),
    ChildStatus=0,
    EnableHorizScroll=False)

# ---- group: Input Label
panel_2 = Panel("------------------------------------Input--------------------------------------")
textsize_2 = Slider(13, range=0..1000)
height_2 = Slider(35, range=0..1000)
width_2 = Slider(600, range=0..1000)
label_2 = CreateLabel(LabelText=panel_2, LabelSize=textsize_2, Justification=0)
adjustpos_2 = AdjustElementPositioning(ElementsToAdjust=label_2, Margin="60,10,5,10", AbsolutePositioning=False, Width=width_2, Height=height_2)

# ---- group: Type
panel_3 = Panel("""quick touch
Hold
Press""")
pulldown = CreatePulldownMenu(Label="Type:", ListItems=panel_3, showLabel=True)

panel_4 = Panel("""Speaker
LED Light
Vibration
Rotational Motion
Translational Motion
Air Pipe""")
pulldown_2 = CreatePulldownMenu(Label="Output parameter", ListItems=panel_4, showLabel=True)

# ---- group: Input Parameter Selection
panel_5 = Panel("""Touch
Button
Light Sensor
Voice
Bluetooth Control""")
pulldown_3 = CreatePulldownMenu(Label="Input parameter:", ListItems=panel_5, showLabel=True)

# ----
values = ValueListener(Elements=pulldown_2, SomeProperty=True)  # -> Values, Indices
values_2 = ValueListener(Elements=pulldown, SomeProperty=True)  # -> Values, Indices
values_3 = ValueListener(Elements=pulldown_3, SomeProperty=True)  # -> Values, Indices

# ---- group: Start button
panel_6 = Panel("Start")

# ----
true_button = CreateTrueOnlyButton(ButtonName=panel_6, ButtonStyle=0)

# ---- group: Start button (continued)
adjustpos_3 = AdjustElementPositioning(
    ElementsToAdjust=true_button,
    AbsolutePositioning=False,
    Width=Slider(100, range=0..100),
    Height=Slider(50, range=0..100))
adjustelem = AdjustElementAppearance(ElementsToAdjust=true_button, FontSize=Slider(14, range=0..100))

# ----
values_4 = ValueListener(Elements=true_button, SomeProperty=True)  # -> Values, Indices

# ---- group: Elements that added to the Main Window
merge = Merge(Data5=label_2, Data6=pulldown_3, Data7=pulldown, Data8=label, Data9=pulldown_2, Data10=true_button)
addelems = AddElements(Window=launchwin, Elements=flatten(merge), DoVLChecking=True)  # -> AddedElements, ElementNames

# ---- group: Main Window
launchwin_2 = LaunchWindow(
    Show=values_4.Values,
    Name="3D Model Interaction Tool",
    Width=Slider(600, range=0..1000),
    Height=Slider(600, range=0..1000),
    ChildStatus=0,
    EnableHorizScroll=False)

# ----
childwin = MakeChildWindow(ParentWindow=launchwin, ChildWindow=launchwin_2)
output = OutputTypeDistinguisher(StartButton=values_4.Values, OutputType=values.Values)  # -> OutputType, LEDLight, RotationalMotion, TranslationalMotion, AirPipe

brighness = Slider(10, range=0..10)
slider = CreateSlider(Slider=brighness, ShowBounds=False, ShowTicks=False, ShowTooltip=False, ShowValLabel=True, showLabel=True)
adjustpos_4 = AdjustElementPositioning(ElementsToAdjust=slider, Margin="0,30,0,0", AbsolutePositioning=False)
hideshow = HideShowElement(ElementToHideShow=slider, Show=output.LEDLight, Collapse=True, Disable=False)

panel_7 = Panel("""Flash
Soft""")
pulldown_4 = CreatePulldownMenu(Label="Light Mode:", ListItems=panel_7, showLabel=True)
adjustpos_5 = AdjustElementPositioning(ElementsToAdjust=pulldown_4, Margin="-1,7,0,0", AbsolutePositioning=False)
hideshow_2 = HideShowElement(ElementToHideShow=pulldown_4, Show=output.LEDLight, Collapse=True, Disable=False)

panel_8 = Panel("""0.5
1
2""")
pulldown_5 = CreatePulldownMenu(Label="Rotation Speed", ListItems=panel_8, showLabel=True)
adjustpos_6 = AdjustElementPositioning(ElementsToAdjust=pulldown_5, Margin="-1,7,0,0", AbsolutePositioning=False)
values_5 = ValueListener(Elements=pulldown_5, SomeProperty=True)  # -> Values, Indices
hideshow_3 = HideShowElement(ElementToHideShow=pulldown_5, Show=output.RotationalMotion, Collapse=True, Disable=False)

scale_factor = Slider(1, range=1..5.001)
slider_2 = CreateSlider(Slider=scale_factor, ShowBounds=False, ShowTicks=False, ShowTooltip=False, ShowValLabel=True, showLabel=True)
values_6 = ValueListener(Elements=slider_2, SomeProperty=True)  # -> Values, Indices
hideshow_4 = HideShowElement(ElementToHideShow=slider_2, Show=output.RotationalMotion, Collapse=True, Disable=False)

button = CreateButton(ButtonName="Cut & Create", ButtonStyle=0)
values_7 = ValueListener(Elements=button, SomeProperty=True)  # -> Values, Indices
hideshow_5 = HideShowElement(ElementToHideShow=button, Show=output.RotationalMotion, Collapse=True, Disable=False)

thickness = Slider(1, range=0.001..5)
slider_3 = CreateSlider(Slider=thickness, ShowBounds=False, ShowTicks=False, ShowTooltip=False, ShowValLabel=True, showLabel=True)
values_8 = ValueListener(Elements=slider_3, SomeProperty=True)  # -> Values, Indices
hideshow_6 = HideShowElement(ElementToHideShow=slider_3, Show=output.RotationalMotion, Collapse=True, Disable=False)

height_3 = Slider(50, range=0..50)
width_3 = Slider(100, range=0..100)

button_2 = CreateButton(ButtonName="Select & Create", ButtonStyle=0)

adjustpos_7 = AdjustElementPositioning(ElementsToAdjust=button_2, AbsolutePositioning=False, Width=width_3, Height=height_3)
hideshow_7 = HideShowElement(ElementToHideShow=button_2, Show=output.LEDLight, Collapse=True, Disable=False)

values_9 = ValueListener(Elements=button_2, SomeProperty=True)  # -> Values, Indices
createpipe = CreatePipe(StartButton=values_9.Values, InputType=values_3.Values, OutputType=output.OutputType)

button_3 = CreateButton(ButtonName="Create", ButtonStyle=0)

values_10 = ValueListener(Elements=button_3, SomeProperty=True)  # -> Values, Indices
hideshow_8 = HideShowElement(ElementToHideShow=button_3, Show=output.RotationalMotion, Collapse=True, Disable=False)

tbvc = TrueButtonValueController(TrueButtonValue=values_10.Values)

cutter = CreateCutter(StartButton=tbvc, OutputType=output.OutputType)
scale = ScaleCutter(Essentials=cutter, ScaleFactor=values_6.Values, Thickness=values_8.Values)
cut_create = CutCreate(Button=values_7.Values, Essentials=scale, GearSpeed=values_5.Values)

height_4 = Slider(50, range=0..50)
width_4 = Slider(100, range=0..100)

button_4 = CreateButton(ButtonName="Select & Create", ButtonStyle=0)
merge_2 = Merge(
    Data1=slider,
    Data2=pulldown_4,
    Data3=button_2,
    Data4=button_3,
    Data5=slider_2,
    Data6=slider_3,
    Data7=pulldown_5,
    Data8=button,
    Data9=button_4)

# ---- group: Elements that added to the Main Window
addelems_2 = AddElements(Window=launchwin_2, Elements=flatten(merge_2), DoVLChecking=True)  # -> AddedElements, ElementNames

# ----
adjustpos_8 = AdjustElementPositioning(ElementsToAdjust=button_4, AbsolutePositioning=False, Width=width_4, Height=height_4)
hideshow_9 = HideShowElement(ElementToHideShow=button_4, Show=output.AirPipe, Collapse=True, Disable=False)

values_11 = ValueListener(Elements=button_4, SomeProperty=True)  # -> Values, Indices
createpipe_2 = CreatePipe(StartButton=values_11.Values, InputType=values_3.Values, OutputType=output.OutputType)
